# Grasshopper definition comfort_mapping.gh (Grasshopper 1.0.7)

# ---- group: Opaque Faces
geo = Geometry([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])
roomsolid = HBRoomFromSolid(
    geo=flatten(geo),
    name="TestRoom",
    constr_set="2013::ClimateZone5::SteelFramed",
    program="2013::LargeOffice::OpenOffice",
    conditioned=True)  # -> report, rooms; plug-in component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

# ---- group: Apertures
# Geometry Preparation
brep = Brep([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])
aperture = HBAperture(geo=brep)  # -> report, apertures; plug-in component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
addsubface = HBAddSubface(hb_obj=flatten(roomsolid.rooms), sub_faces=flatten(aperture.apertures))  # -> hb_obj; plug-in component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
bordershades = HBExtrudedBorderShades(hb_objs=flatten(addsubface), depth="0.3")  # -> report, hb_objs; plug-in component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

# ---- group: Context!
brep_2 = Brep([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])
shade = HBShade(geo=brep_2)  # -> report, shades; plug-in component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

# ----
# Model
# + Grids
panel = Panel("sample_model_grid")
model = HBModel(rooms=flatten(bordershades.hb_objs), shades=flatten(shade.shades), name=panel)  # -> report, model; plug-in component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
gridrooms = HBSensorGridFromRooms(rooms=bordershades.hb_objs, grid_size="1")  # -> grid, points, mesh; plug-in component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
assigngridsviews = HBAssignGridsAndViews(model=model.model, grids=flatten(gridrooms.grid))  # -> model; plug-in component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
vizwiref = HBVizualizeWireframe(hb_objs=flatten(model.model))  # -> geo; plug-in component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

# ----
# EPW
panel_2 = Panel("https://www.energyplus.net/weather-download/north_and_central_america_wmo_region_4/USA/MA/USA_MA_Boston-Logan.Intl.AP.725090_TMY3/all")
downloadepw = LBDownloadWeather(weather_URL=panel_2)  # -> epw_file, stat_file, ddy_file; plug-in component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

# ----
# Run Recipe
panel_3 = Panel("--workers 10")
pmvmap = HBPMVComfortMap(
    model=assigngridsviews,
    epw=downloadepw.epw_file,
    ddy=downloadepw.ddy_file,
    sensor_count="30",
    clo_value="1",
    run_settings=panel_3,
    run=Toggle(False))  # -> report, temperature, condition, pmv, TCP, HSP, CSP; plug-in component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

mjoin = MeshJoin(Meshes=gridrooms.mesh)
colrange = LBColorRange(index="10")  # -> colors; plug-in component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
panel_4 = Panel("0")
panel_5 = Panel("100")
legendpar = LBLegendParameters(colors=colrange)  # -> leg_par; plug-in component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
heatmap = LBSpatialHeatmap(values=flatten(pmvmap.HSP), mesh=mjoin, legend_par=legendpar, legend_title="%")  # -> mesh, legend, title, colors, legend_par; plug-in component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

colrange_2 = LBColorRange(index="11")  # -> colors; plug-in component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
move = Move(Geometry=mjoin, Motion="40,0,0")  # -> Geometry, Transform
move_2 = Move(Geometry=vizwiref, Motion="40,0,0")  # -> Geometry, Transform
legendpar_2 = LBLegendParameters(colors=colrange_2)  # -> leg_par; plug-in component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
heatmap_2 = LBSpatialHeatmap(values=flatten(pmvmap.CSP), mesh=move.Geometry, legend_par=legendpar_2, legend_title="%")  # -> mesh, legend, title, colors, legend_par; plug-in component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
