# Grasshopper definition full_building_energy_model.gh (Grasshopper 1.0.7)

# ----
# Construction Set
bldg_vintage = Dragonfly_BldgAge({"ASHRAE 90.1 2013  |  IECC 2015": "2013", "ASHRAE 90.1 2010  |  IECC 2012": "2010", "ASHRAE 90.1 2007  |  IECC 2009": "2007", "ASHRAE 90.1 2004  |  IECC 2006": "2004", "1980-2004 (CBECS)": "1980_2004", "Pre-1980 (CBECS)": "pre_1980"}, selected="ASHRAE 90.1 2013  |  IECC 2015")
constr_type = Dragonfly_BldgAge({"SteelFramed", "WoodFramed", "Mass", "Metal Building"}, selected="SteelFramed")
climate_zone = Dragonfly_BldgAge({"1 - Very Hot": "1", "2 - Hot": "2", "3 - Warm": "3", "4 - Mixed": "4", "5 - Cool": "5", "6 - Cold": "6", "7 - Very Cold": "7", "8 - Subarctic": "8"}, selected="5 - Cool")
searchconstrset = HBSearchConstructionSets(climate_zone=climate_zone, vintage=bldg_vintage, constr_type=constr_type)  # -> constr_set; plug-in component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

toggle = BooleanToggle(True)

# ----
# Office
panel = Panel("Office")
offices = Geometry([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])
roomsolid = HBRoomFromSolid(
    geo=flatten(offices),
    name=panel,
    program="2013::MediumOffice::ClosedOffice",
    constr_set=searchconstrset,
    conditioned=True,
    run=toggle)  # -> report, rooms; plug-in component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

# ----
# Conference
panel_2 = Panel("2013::MediumOffice::Conference")
conference = Geometry([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])
roomsolid_2 = HBRoomFromSolid(geo=flatten(conference), name="Conference", program=panel_2, constr_set=searchconstrset, conditioned=True, run=toggle)  # -> report, rooms; plug-in component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

# ----
# Lab Support
panel_3 = Panel("Lab Support")
research_lab = Geometry([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])
roomsolid_3 = HBRoomFromSolid(
    geo=flatten(research_lab),
    name=panel_3,
    program="2013::Laboratory::Lab with fume hood",
    constr_set=searchconstrset,
    conditioned=True,
    run=toggle)  # -> report, rooms; plug-in component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

# ----
# Classroom
panel_4 = Panel("2013::MediumOffice::Classroom")
classroom = Geometry([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])
roomsolid_4 = HBRoomFromSolid(geo=flatten(classroom), name="Classroom", program=panel_4, constr_set=searchconstrset, conditioned=True, run=toggle)  # -> report, rooms; plug-in component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

# ----
# Writeup
panel_5 = Panel("Writeup")
wrietup = Geometry(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)
roomsolid_5 = HBRoomFromSolid(
    geo=flatten(wrietup),
    name=panel_5,
    program="2013::Laboratory::Office",
    constr_set=searchconstrset,
    conditioned=True,
    run=toggle)  # -> report, rooms; plug-in component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

# ----
# Laboratory
panel_6 = Panel("Laboratory")
lab_support = Geometry([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])
roomsolid_6 = HBRoomFromSolid(
    geo=flatten(lab_support),
    name=panel_6,
    program="2013::Laboratory::Open lab",
    constr_set=searchconstrset,
    conditioned=True,
    run=toggle)  # -> report, rooms; plug-in component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

# ----
# Corridor
corridor = Geometry([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])
roomsolid_7 = HBRoomFromSolid(
    geo=flatten(corridor),
    name="Corridor",
    program="2013::MediumOffice::Corridor",
    constr_set=searchconstrset,
    conditioned=True,
    run=toggle)  # -> report, rooms; plug-in component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

# ----
# Storage
panel_7 = Panel("2013::MediumOffice::Storage")
storage = Geometry([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])
roomsolid_8 = HBRoomFromSolid(geo=flatten(storage), name="Storage", program=panel_7, constr_set=searchconstrset, conditioned=Toggle(False), run=toggle)  # -> report, rooms; plug-in component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

allrooms = Data(flatten([roomsolid.rooms, roomsolid_5.rooms, roomsolid_3.rooms, roomsolid_6.rooms, roomsolid_2.rooms, roomsolid_4.rooms, roomsolid_7.rooms, roomsolid_8.rooms]))

# ----
# Solve Adjacency
solveadj = HBSolveAdjacency(rooms=flatten(allrooms), run=toggle)  # -> report, adj_rooms; plug-in component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

facparam = HBFacadeParameters(north=0, east=Toggle(False), south=0, west=Toggle(True))  # -> fac_par; plug-in component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

facparam_2 = HBFacadeParameters(north="0.5", east="1", south="0.5", west="1")  # -> fac_par; plug-in component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

facparam_3 = HBFacadeParameters(north="0", east="45", south="0", west="-45")  # -> fac_par; plug-in component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

# ----
# Generate Facade
panel_8 = Panel("0.35")
aperturesbyratio = HBAperturesByRatio(hb_objs=flatten(solveadj.adj_rooms), ratio=panel_8, win_height="2.8", run=toggle)  # -> report, hb_objs; plug-in component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
louvershades = HBLouverShades(
    hb_objs=flatten(aperturesbyratio.hb_objs),
    depth=facparam_2,
    angle=facparam_3,
    vertical=Toggle(True),
    flip_start=facparam,
    run=toggle)  # -> report, hb_objs; plug-in component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

# ----
# Edit the HVAC
toggle_2 = BooleanToggle(True)
idealair = HBIdealAir(rooms=flatten(louvershades.hb_objs), dcv=toggle_2, sensible_hr="0.81", latent_hr="0.75")  # -> report, rooms; plug-in component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

# ----
# Make Adiabatic
adiabaticbytype = HBAdiabaticByType()  # -> hb_objs; plug-in component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

all_rooms = Data(flatten(idealair.rooms))

# ----
# Visualize Rooms
faceenergyattr = HBFaceEnergyAttributes({"Construction": "properties.energy.construction.name", "Materials": "properties.energy.construction.layers", "R-Value": "properties.energy.construction.r_value", "U-Value": "properties.energy.construction.u_value", "U-Factor": "properties.energy.construction.u_factor", "Solar Transmitance [Unshaded]": "properties.energy.construction.unshaded_solar_transmittance", "Solar Reflectance [Outside]": "properties.energy.construction.outside_solar_reflectance", "Solar Reflectance [Inside]": "properties.energy.construction.inside_solar_reflectance"}, selected="Construction")
roomenergyattr = HBRoomEnergyAttributes({"Program": "properties.energy.program_type.name", "Construction Set": "properties.energy.construction_set.name", "Is Conditioned": "properties.energy.is_conditioned", "People per Area [ppl/m2]": "properties.energy.people.people_per_area", "Area per Person [m2/ppl]": "properties.energy.people.area_per_person", "Lighting per Area [W/m2]": "properties.energy.lighting.watts_per_area", "Electric Equipment per Area [W/m2]": "properties.energy.electric_equipment.watts_per_area", "Gas Equipment per Area [W/m2]": "properties.energy.gas_equipment.watts_per_area", "Infiltration per Exterior Area [m3/s-m2]": "properties.energy.infiltration.flow_per_exterior_area", "Ventilation per Person [m3/s-ppl]": "properties.energy.ventilation.flow_per_person"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}, selected="Program")
lablefaces = HBLabelFaces(hb_obj=flatten(all_rooms), attribute=faceenergyattr, sub_faces=Toggle(False))  # -> label_text, base_pts, labels, wire_frame; plug-in component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
labelrooms = HBLabelRooms(rooms=flatten(all_rooms), attribute=roomenergyattr)  # -> label_text, base_pts, labels, wire_frame; plug-in component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

# ----
# Simulation Parameters
toggle_3 = BooleanToggle(True)
simoutput = HBSimulationOutput(zone_energy_use=toggle_3, report_frequency="Monthly", summary_reports="AllSummary")  # -> report, sim_output; plug-in component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
simcontrol = HBSimulationControl()  # -> sim_control; plug-in component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
analysisperiod = LadybugPlus_AnalysisPeriod(start_month="1", start_day="1", start_hour=0, end_month="1")  # -> analysis_period, hoys, dates; plug-in component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
shadowcalc = HBShadowCalculation(solar_dist="FullExteriorWithReflections")  # -> shadow_calc; plug-in component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
sizingpar = HBSizingParameter()  # -> sizing; plug-in component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
customoutput = HBCustomSimulationOutput(base_sim_output=simoutput.sim_output, output_names="Zone Mean Air Temperature")  # -> report, sim_output; plug-in component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
simpar = HBSimulationParameter(
    output=customoutput.sim_output,
    run_period=analysisperiod.analysis_period,
    timestep=6,
    sim_control=simcontrol,
    shadow_calc=shadowcalc,
    sizing=sizingpar)  # -> sim_par; plug-in component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

# ----
# Download EPW File
panel_9 = Panel("https://www.energyplus.net/weather-download/north_and_central_america_wmo_region_4/USA/MA/USA_MA_Boston-Logan.Intl.AP.725090_TMY3/all")
downloadweather = LadybugPlus_DownloadWeather(weather_URL=panel_9)  # -> epw_file, stat_file, ddy_file; plug-in component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

# ----
# Create the Model
panel_10 = Panel("LabBuilding")
model = HBModel(rooms=flatten(all_rooms), north="10", name=panel_10)  # -> report, model; plug-in component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

toggle_4 = BooleanToggle(False)
modeltoosm = HBModelToOSM(model=model.model, epw_file=downloadweather.epw_file, sim_par=simpar, write=toggle_4, run=toggle_4)  # -> report, jsons, osw, osm, idf, sql, zsz, rdd, html; plug-in component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

# ----
# Import Results
panel_11 = Panel("Zone Mean Air Temperature")
roomenergyresult = HBReadRoomEnergyResult(sql=modeltoosm.sql)  # -> cooling, heating, lighting, electric_equip, gas_equip, fan_electric, pump_electric, people_gain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; plug-in component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
roomcustomresult = HBReadCustomResult(sql=modeltoosm.sql, output_names=panel_11)  # -> results; plug-in component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

panel_12 = Panel("C:\Users\chris\Documents\GitHub\honeybee-grasshopper-energy\honeybee_grasshopper_energy")
createuo = LBCreateUserObject(folder=panel_12, change_type="ignore", export=Toggle(False))  # -> read_me; plug-in component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
