# Grasshopper definition shoe_box_peak_loads.gh (Grasshopper 1.0.7)

# ----
# Create Shoe Box
panel = Panel("10")
box = DomainBox(Base=PlaneXY(0, 0, 0), X="10", Y=panel, Z="3")
debrep = DeconstructBrep(Brep=box)  # -> Faces, Edges, Vertices
panel_2 = Panel("""0
1
3
4
5""")
item = ListItem(List=debrep.Faces, Index="2", Wrap=True)
item_2 = ListItem(List=debrep.Faces, Index=panel_2, Wrap=True)

# ---- group: Chage Glazing Ratio, Orientation, and Program
number_slider = Slider(6, range=0..8, expression="x * 45")
number_slider_2 = Slider(0.6, range=0.1..0.9)

# ----
# Create Honeybee Room
panel_3 = Panel("outdoors")
geo = Geometry(item)
geo_2 = Geometry(item_2)
face = HBFace(geo=geo, bc=panel_3)  # -> report, faces; plug-in component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
face_2 = HBFace(geo=geo_2, bc="adiabatic")  # -> report, faces; plug-in component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
aperturesbyratio = HBAperturesByRatio(hb_objs=flatten(face.faces), ratio=number_slider_2, subdivide=Toggle(False))  # -> report, hb_objs; plug-in component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
room = HBRoom(
    faces=flatten([face_2.faces, aperturesbyratio.hb_objs]),
    name="Hospital Shoe Box",
    constr_set="2013::ClimateZone5::SteelFramed",
    program="2013::LargeOffice::OpenOffice",
    conditioned=True)  # -> report, room; plug-in component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
rotate = HBRotate(hb_objs=flatten(room.room), angle=number_slider)  # -> hb_objs; plug-in component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

# ----
# Download DDY File
panel_4 = Panel("https://www.energyplus.net/weather-download/north_and_central_america_wmo_region_4/USA/CA/USA_CA_Los.Angeles.Intl.AP.722950_TMY3/all")
downloadepw = LBDownloadWeather(weather_URL=panel_4)  # -> epw_file, stat_file, ddy_file; plug-in component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

# ---- group: Run Me!
toggle = BooleanToggle(False)

# ----
# Create Legend Parameters
swatch = ColourSwatch(SwatchColor=RGB(255, 175, 46))
col = Colour([ColourSwatch(SwatchColor=RGB(255, 251, 0)), ColourSwatch(SwatchColor=RGB(255, 0, 0)), ColourSwatch(SwatchColor=RGB(148, 24, 24)), ColourSwatch(SwatchColor=RGB(135, 178, 224)), swatch, ColourSwatch(SwatchColor=RGB(255, 242, 140)), ColourSwatch(SwatchColor=RGB(204, 204, 204))])
replace = ReplacePaths(Data=simplify(col), Search="{0}", Replace="{1}")
dup = DuplicateData(Data=ColourSwatch(SwatchColor=RGB(37, 93, 153)), Number=2, Order=True)
legendpar = LBLegendParameters(min="0", max="10000", colors=[replace, dup], num_decimals="0")  # -> leg_par; plug-in component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

peakloads = HBPeakLoads(rooms=rotate, ddy_file=downloadepw.ddy_file, run_bal=toggle, run=toggle)  # -> report, peak_cool, peak_heat, cooling, heating, cool_bal, heat_bal; plug-in component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

# ----
# Plot Loads Over the Day
panel_5 = Panel("""0,50,0
0,0,0""")
data = Data(simplify(graft(panel_5)))
monthlychart = LBMonthlyChart(data=[peakloads.cool_bal, peakloads.cooling], base_pt=data, x_dim="40", stack=Toggle(True), legend_par=legendpar)  # -> report, data_mesh, data_lines, legend, borders, labels, y_title, title; plug-in component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
item_3 = ListItem(List=flatten(monthlychart.legend), Index=[0, 1], Wrap=True)
medges = MeshEdges(Mesh=item_3)  # -> NakedEdges, InteriorEdges, NonManifoldEdges
