# Grasshopper definition single_family_comfort_study.gh (Grasshopper 1.0.7)

# ---- group: Passive ConstructionSet
txt = Text("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")
strtoobj = HBStringToObject(hb_str=txt)  # -> hb_obj; plug-in component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

# ---- group: Passive Program
txt_2 = Text("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")
strtoobj_2 = HBStringToObject(hb_str=txt_2)  # -> hb_obj; plug-in component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

# ----
geo = Geometry(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)
aperture = HBAperture(geo=geo)  # -> report, apertures; plug-in component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

# ----
# Setup Model
toggle = BooleanToggle(True)
geo_2 = Geometry([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])
intsolid = HBIntersectSolids(solids=flatten(geo_2), run=toggle)  # -> int_solids; plug-in component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
geo_3 = Geometry([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])
aperture_2 = HBAperture(geo=geo_3, operable=Toggle(True))  # -> report, apertures; plug-in component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
roomsolid = HBRoomFromSolid(
    geo=flatten(intsolid),
    name="Residence",
    constr_set="2004::ClimateZone3::SteelFramed",
    program="2019::MidriseApartment::Apartment",
    conditioned=True)  # -> report, rooms; plug-in component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
bordershades = HBExtrudedBorderShades(hb_objs=flatten(aperture_2.apertures), depth="0.3")  # -> report, hb_objs; plug-in component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
addsubface = HBAddSubface(hb_obj=flatten(roomsolid.rooms), sub_faces=flatten([bordershades.hb_objs, aperture.apertures]))  # -> hb_obj; plug-in component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
geo_4 = Geometry([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])
solveadj = HBSolveAdjacency(rooms=flatten(addsubface), run=toggle)  # -> report, adj_rooms; plug-in component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
shade = HBShade(geo=geo_4)  # -> report, shades; plug-in component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

# ----
# Request Outputs
toggle_2 = BooleanToggle(True)
simoutput = HBSimulationOutput(zone_energy_use=toggle_2, comfort_metrics=toggle_2, surface_temperature=toggle_2)  # -> report, sim_output; plug-in component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
simpar = HBSimulationParameter(output=simoutput.sim_output, timestep=6)  # -> sim_par; plug-in component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

# ----
# Download EPW File
panel = Panel("http://climate.onebuilding.org/WMO_Region_4_North_and_Central_America/USA_United_States_of_America/CA_California/USA_CA_Burbank-Hope.AP.722880_TMY3.zip")
downloadepw = LBDownloadWeather(weather_URL=panel)  # -> epw_file, stat_file, ddy_file; plug-in component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

house_shades = Data(flatten(shade.shades))
house_rooms = Data(flatten(solveadj.adj_rooms))

# ----
# Create Model
panel_2 = Panel("single_family_home")
model = HBModel(rooms=flatten(house_rooms), shades=flatten(house_shades), name=panel_2)  # -> report, model; plug-in component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

toggle_3 = BooleanToggle(False)
modeltoosm = HBModelToOSM(model=model.model, epw_file=downloadepw.epw_file, sim_par=simpar, write=toggle_3, run=toggle_3)  # -> report, jsons, osw, osm, idf, sql, zsz, rdd, html; plug-in component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

faceresult = HBReadFaceResult(sql=modeltoosm.sql)  # -> face_indoor_temp, face_outdoor_temp, face_energy_flow; plug-in component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
roomcomfortresult = HBReadRoomComfortResult(sql=modeltoosm.sql)  # -> oper_temp, air_temp, rad_temp, rel_humidity; plug-in component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

eui = HBEndUseIntensity(sql=modeltoosm.sql)  # -> eui, eui_end_use, end_uses, gross_floor; plug-in component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
panel_3 = Panel(eui.eui)

data = Data(model.model)

# ----
# Color Geometry
# with Results
colorrooms = HBColorRooms(data=flatten(roomcomfortresult.oper_temp), rooms_model=flatten(data))  # -> report, mesh, wire_frame, legend, title, rooms, colors, values; plug-in component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
colorfaces = HBColorFaces(data=flatten(faceresult.face_indoor_temp), hb_objs=flatten(data), sim_step=Slider(0, range=0..23))  # -> report, mesh, wire_frame, legend, title, faces, colors, values; plug-in component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

# ----
# Perform an Hourly Comfort Study
importepw = LBImportEPW(epw_file=downloadepw.epw_file)  # -> location, dry_bulb_temperature, dew_point_temperature, relative_humidity, wind_speed, wind_direction, direct_normal_rad, diffuse_horizontal_rad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; plug-in component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
analysisperiod = LBAnalysisPeriod(start_month=1, start_day=1, start_hour="8", end_hour="22")  # -> period, hoys, dates; plug-in component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
clobytemp = LBClothingByTemperature(temperature=importepw.dry_bulb_temperature, period=analysisperiod.period, max_clo_temp="12")  # -> report, clo; plug-in component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
applyper = LBApplyAnalysisPeriod(data=roomcomfortresult.air_temp, period=analysisperiod.period)  # -> data; plug-in component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
applyper_2 = LBApplyAnalysisPeriod(data=roomcomfortresult.rad_temp, period=analysisperiod.period)  # -> data; plug-in component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
applyper_3 = LBApplyAnalysisPeriod(data=roomcomfortresult.rel_humidity, period=analysisperiod.period)  # -> data; plug-in component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

pmv = LBPMVComfort(
    air_temp=applyper,
    mrt=applyper_2,
    rel_humid=applyper_3,
    met_rate=Slider(1.2, range=1..1.3),
    clothing=clobytemp.clo,
    run=Toggle(True))  # -> report, pmv, ppd, set, comfort, condition, heat_loss, comf_obj; plug-in component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

hourlyplot = LBHourlyPlot(data=pmv.condition, base_pt="50,0,0")  # -> report, mesh, legend, borders, labels, title; plug-in component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

# ----
# Label with the % of Time Comfortable
comfstat = LBComfortStatistics(comf_obj=pmv.comf_obj)  # -> pct_hot, pct_neutral, pct_cold; plug-in component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
area = Area(Geometry=colorrooms.mesh)  # -> Area, Centroid
round = Round(Number=comfstat.pct_neutral)  # -> Nearest, Floor, Ceiling
concat = Concatenate(FragmentA=round.Nearest, FragmentB="% Comfortable")
tag = TextTag3D(Location=area.Centroid, Text=concat, Size="0.5", Justification="5")
